# Dynamo graph TCI_CS_class-create-wall-type_fuseki-data.dyn (Dynamo 2.0.2.6826)

# group: Get insitu Wall Types used in Model
wall_types = WallTypes(index=85)
all_elements_of_family_type = Custom[All Elements of Family Type+](familyType=wall_types)  # Unlike the built-in node, this node retrieves all placed instances of a given loadable *or* system family type
wall_types_2 = WallTypes(index=86)
all_elements_of_family_type_2 = Custom[All Elements of Family Type+](familyType=wall_types_2)
wall_types_3 = WallTypes(index=88)
all_elements_of_family_type_3 = Custom[All Elements of Family Type+](familyType=wall_types_3)
# note: NB! Requires the Clockwork package
join = List.Join(list0=all_elements_of_family_type, list1=all_elements_of_family_type_2, list2=all_elements_of_family_type_3)
elementType = Custom[Element.ElementType+](element=join)  # Gets the family type of a given element (if applicable). Unlike the OOTB node, it also works for elements in linked models.
uniqueItems = List.UniqueItems(list=elementType)

# group: Generate triples for class create
class_namespace = CodeBlock { "http://test/rvt/"; }
superclass_namespace = CodeBlock { ["product", "https://w3id.org/product#"]; }
superclass = CodeBlock { "product:Wall"; }
datatype_namespace = CodeBlock { ["xsd","http://www.w3.org/2001/XMLSchema#"]; }
datatype = CodeBlock { "xsd:string"; }
# note: [0] Class namespace
# [1] Superclass namespace
# [2] Super class
# [3] Type Label
# [4] Datatype Namespace
# [5] Datatype
create_class = Python(IN[0]=class_namespace, IN[1]=superclass_namespace, IN[2]=superclass, IN[3]=uniqueItems, IN[4]=datatype_namespace, IN[5]=datatype)
# ---------- create_class.python (49 lines) ----------
import sys
sys.path.append(r'C:\Program Files (x86)\IronPython 2.7\Lib')
import urllib

#The inputs to this node will be stored as a list in the IN variables.
classNS = 		IN[0]
superClassPFX = IN[1][0]
superClassNS = 	IN[1][1]
superClass = 	IN[2]
classes =		IN[3]
dtPFX = 		IN[4][0]
dtNS = 			IN[4][1]
dt = 			IN[5]

def _get_id_name(e):
	# Make lowercase and replace æ, ø, å
	n = e.Name.lower()
	n = n.replace('æ', 'ae').replace('ø', 'oe').replace('å', 'aa')
	# Make PascalCaseName
	n = ''.join(x for x in n.title() if x.isalnum())
	# URL encode
	n = urllib.quote(n)
	return n

# PREFIXES
str = "@prefix rvt: <%s> .\n" % classNS
str+= "@prefix owl: <http://www.w3.org/2002/07/owl#> .\n"
str+= "@prefix rdf: <http://www.w3.org/1999/02/22-rdf-syntax-ns#> .\n"
str+= "@prefix rdfs: <http://www.w3.org/2000/01/rdf-schema#> .\n"
str+= "@prefix %s: <%s> .\n" % (superClassPFX, superClassNS)
str+= "@prefix %s: <%s> .\n\n" % (dtPFX, dtNS)

# INSTANCES
seen = set()
err = False
for c in classes:
	# Make PascalCaseName
	n = _get_id_name(c)
	if n in seen:
		err = True
	seen=seen | set([n])
	
	str+= 'rvt:%s rdf:label "%s"^^%s ;\n' % (n, n, dt)
	str+= "\ta owl:Class ;\n"
	str+= "\trdfs:subClassOf %s .\n" % (superClass)
if not err:
	OUT = str
else:
	OUT = "Duplicate class names were discovered"
# ----------------------------------------

# note: Create Wall Type Class as owl:Class
watch = Watch(create_class)

# group: Write to server
code_block = CodeBlock { "localhost:3030/TCI-CaseStudy-Revit/data"; }
post_to_opm_rest = Python(IN[0]=code_block, IN[1]=watch)
# ---------- post_to_opm_rest.python (31 lines) ----------
import sys
sys.path.append('C:\Program Files (x86)\IronPython 2.7\Lib')
import httplib, urllib

# The inputs to this node will be stored as a list in the IN variables.
url = IN[0]
triples = IN[1]

first_slash = url.find('/')
host = url[:first_slash]
route = url[first_slash:]

conn = httplib.HTTPConnection(host)

# Define headers
headers = {"Content-type": "text/turtle", "Accept": "text/plain"}

# Send request
conn.request('POST', route, triples, headers)

# Get response
response = conn.getresponse()

# Read response
data = response.read()

# Close db connection
conn.close()

# Assign your output to the OUT variable.
OUT = data
# ----------------------------------------
watch_2 = Watch(post_to_opm_rest)

# group: Generate triples for class assignment
element_namespace = CodeBlock { "http://test/walls/"; }
# note: [0] Class namespace
# [1] Element namespace
# [2] Element classes
# [3] Elements
assign_class = Python(IN[0]=class_namespace, IN[1]=element_namespace, IN[2]=elementType, IN[3]=join)
# ---------- assign_class.python (32 lines) ----------
import sys
sys.path.append(r'C:\Program Files (x86)\IronPython 2.7\Lib')
import urllib

#The inputs to this node will be stored as a list in the IN variables.
classNS = 	IN[0]
elementNS = IN[1]
classes = 	IN[2]
elements =	IN[3]

def _get_id_name(e):
	# Make lowercase and replace æ, ø, å
	n = e.Name.lower()
	n = n.replace('æ', 'ae').replace('ø', 'oe').replace('å', 'aa')
	# Make PascalCaseName
	n = ''.join(x for x in n.title() if x.isalnum())
	# URL encode
	n = urllib.quote(n)
	return n

# PREFIXES
str = "@prefix wallinst: <%s> .\n" % elementNS
str+= "@prefix rvt: <%s> .\n\n" % classNS
str+= "@prefix props: <https://w3id.org/props#> .\n\n"

# INSTANCES
for i, e in enumerate(elements):
	cl = elements[i]
	classId = _get_id_name(cl)
	str+= "wallinst:%s props:wallType rvt:%s .\n" % (e.UniqueId, classId)

OUT = str
# ----------------------------------------

# note: Assign Wall Instances to wall type
watch_3 = Watch(assign_class)

# group: Write to server
code_block_2 = CodeBlock { "localhost:3030/TCI-CaseStudy-Revit/data"; }
post_to_opm_rest_2 = Python(IN[0]=code_block_2, IN[1]=watch_3)  # same code as post_to_opm_rest
watch_4 = Watch(post_to_opm_rest_2)

# group: Write to file
file_path = Filename(".\TCI_CS_class-create-wall-type_fuseki-data1.ttl")
writeText = FileSystem.WriteText(filePath=file_path, text=watch)

# group: Write to file
file_path_2 = Filename(".\TCI_CS_class-create-wall-type_fuseki-data2.ttl")
writeText_2 = FileSystem.WriteText(filePath=file_path_2, text=watch_3)
