# Dynamo graph TCI_CS_class-prop-wm_fuseki-data.dyn (Dynamo 2.0.2.6826)

# group: Get element types used in model
categories = Categories(index=604)  # graph input
all_elements_of_category = ElementsOfCategory(Category=categories)
elementType = Custom[Element.ElementType+](element=all_elements_of_category)  # Gets the family type of a given element (if applicable). Unlike the OOTB node, it also works for elements in linked models.
uniqueItems = List.UniqueItems(list=elementType)

# group: Get element types in model
wall_types = WallTypes(index=85)
all_elements_of_family_type = Custom[All Elements of Family Type+](familyType=wall_types)  # Unlike the built-in node, this node retrieves all placed instances of a given loadable *or* system family type
wall_types_2 = WallTypes(index=86)
all_elements_of_family_type_2 = Custom[All Elements of Family Type+](familyType=wall_types_2)
wall_types_3 = WallTypes(index=88)
all_elements_of_family_type_3 = Custom[All Elements of Family Type+](familyType=wall_types_3)
join = List.Join(list0=all_elements_of_family_type, list1=all_elements_of_family_type_2, list2=all_elements_of_family_type_3)
# note: NB! Requires the Clockwork package
elementType_2 = Custom[Element.ElementType+](element=join)
uniqueItems_2 = List.UniqueItems(list=elementType_2)

watch = Watch(uniqueItems_2)

# group: Get property Width
code_block = CodeBlock { "Width"; }
getParameterValueByName = Element.GetParameterValueByName(element=uniqueItems_2, parameterName=code_block)

code_block_2 = CodeBlock(value=getParameterValueByName) { Math.Round(value, 2); }
watch_2 = Watch(code_block_2)
property = CodeBlock { "props:material"; }
datatype_namespace = CodeBlock { ["xsd","http://www.w3.org/2001/XMLSchema#"]; }
datatype = CodeBlock { "xsd:string"; }

# group: Get Property Material
code_block_3 = CodeBlock { "Structural Material"; }
getParameterValueByName_2 = Element.GetParameterValueByName(element=uniqueItems_2, parameterName=code_block_3)
name = Custom[Element.Name+](element=getParameterValueByName_2)  # Gets an element's name. Unlike the OOTB node, this node should work for all Revit elements that have names and will also return the localized names of system parameters, parameter groups, display unit types, parameter types, unit symbol types and unit types.

watch_3 = Watch(name)
property_2 = CodeBlock { "props:ccsTypeID"; }

# group: Get Property CCSTypeID
code_block_4 = CodeBlock { "CCSTypeID"; }
getParameterValueByName_3 = Element.GetParameterValueByName(element=uniqueItems_2, parameterName=code_block_4)

watch_4 = Watch(getParameterValueByName_3)

# group: Generate triples
class_namespace = CodeBlock { "http://test/rvt/"; }
property_namespace = CodeBlock { ["props", "https://w3id.org/props#"]; }
property_3 = CodeBlock { "props:width"; }
datatype_namespace_2 = CodeBlock { ["xsd","http://www.w3.org/2001/XMLSchema#"]; }
datatype_2 = CodeBlock { "xsd:decimal"; }
# note: [0]Instance namespace
# [1]Property namespace
# [2]Property
# [3]Datatype namespace
# [4]Datatype
# [5]Elements
# [6]Properties
assign_property = Python(IN[0]=class_namespace, IN[1]=property_namespace, IN[2]=property_3, IN[3]=datatype_namespace_2, IN[4]=datatype_2, IN[5]=watch, IN[6]=watch_2, IN[7]=property, IN[8]=datatype_namespace, IN[9]=datatype, IN[10]=watch_3, IN[11]=property_2, IN[12]=watch_4)
# ---------- assign_property.python (46 lines) ----------
import sys
sys.path.append(r'C:\Program Files (x86)\IronPython 2.7\Lib')
import urllib

#The inputs to this node will be stored as a list in the IN variables.
classNS = IN[0]
propPFX = IN[1][0]
propNS = IN[1][1]
prop = IN[2]
dtPFX = IN[3][0]
dtNS = IN[3][1]
dt = IN[4]
elements = IN[5]
properties = IN[6]
prop2 = IN[7]
dt2PFX = IN[8][0]
dt2NS = IN[8][1]
dt2 = IN[9]
properties2 = IN[10]
prop3 = IN[11]
properties3 = IN[12]

def _get_id_name(e):
	# Make lowercase and replace æ, ø, å
	n = e.Name.lower()
	n = n.replace('æ', 'ae').replace('ø', 'oe').replace('å', 'aa')
	# Make PascalCaseName
	n = ''.join(x for x in n.title() if x.isalnum())
	# URL encode
	n = urllib.quote(n)
	return n

# PREFIXES
str = "@prefix rvt: <%s> .\n" % classNS
str+= "@prefix %s: <%s> .\n" % (propPFX, propNS)
str+= "@prefix %s: <%s> .\n" % (dtPFX, dtNS)
str+= "@prefix %s: <%s> .\n\n" % (dt2PFX, dt2NS)

# INSTANCES
for i, e in enumerate(elements):
	classId = _get_id_name(e)
	str+= 'rvt:%s %s "%s"^^%s ;\n' % (classId, prop, properties[i], dt)
	str+= '\t%s "%s"^^%s ;\n' % (prop2, properties2[i], dt2)
	str+= '\t%s "%s"^^%s .\n' % (prop3, properties3[i], dt2)

OUT = str
# ----------------------------------------

watch_5 = Watch(assign_property)

# group: Write to server
code_block_5 = CodeBlock { "localhost:3030/TCI-CaseStudy-Revit/data"; }
post_to_opm_rest = Python(IN[0]=code_block_5, IN[1]=watch_5)
# ---------- post_to_opm_rest.python (31 lines) ----------
import sys
sys.path.append('C:\Program Files (x86)\IronPython 2.7\Lib')
import httplib, urllib

# The inputs to this node will be stored as a list in the IN variables.
url = IN[0]
triples = IN[1]

first_slash = url.find('/')
host = url[:first_slash]
route = url[first_slash:]

conn = httplib.HTTPConnection(host)

# Define headers
headers = {"Content-type": "text/turtle", "Accept": "text/plain"}

# Send request
conn.request('POST', route, triples, headers)

# Get response
response = conn.getresponse()

# Read response
data = response.read()

# Close db connection
conn.close()

# Assign your output to the OUT variable.
OUT = data
# ----------------------------------------
watch_6 = Watch(post_to_opm_rest)

# group: Write to file
file_path = Filename(".\TCI_CS_class-prop-wm_fuseki-data.ttl")
writeText = FileSystem.WriteText(filePath=file_path, text=watch_5)

parameters = Element.Parameters(element=uniqueItems_2)
