# Dynamo graph TCI_CS_storey-has-inst_fuseki-data.dyn (Dynamo 2.0.2.6826)

storey_namespace = CodeBlock { "http://test/levels/"; }
wall_types = WallTypes(index=85)
all_elements_of_family_type = Custom[All Elements of Family Type+](familyType=wall_types)  # Unlike the built-in node, this node retrieves all placed instances of a given loadable *or* system family type
wall_types_2 = WallTypes(index=86)
all_elements_of_family_type_2 = Custom[All Elements of Family Type+](familyType=wall_types_2)
wall_types_3 = WallTypes(index=88)
all_elements_of_family_type_3 = Custom[All Elements of Family Type+](familyType=wall_types_3)
join = List.Join(list0=all_elements_of_family_type, list1=all_elements_of_family_type_2, list2=all_elements_of_family_type_3)

# group: Get storey
code_block = CodeBlock { "WALL_BASE_CONSTRAINT"; }
get_built_in_parameter = Custom[Get Built In Parameter](ParameterNames=code_block, Elements=join)  # This node will take an input of a built in parameter name and element to return that parameters value.

watch = Watch(get_built_in_parameter)

# group: Generate triples
# note: NB! Depends on package Archi-lab
space_namespace = CodeBlock { "http://test/walls/"; }
# note: [0] Wall namespace
# [1] Storey namespace
# [2] Walls
# [3] Storeys
assign_property = Python(IN[0]=space_namespace, IN[1]=storey_namespace, IN[2]=join, IN[3]=watch)
# ---------- assign_property.python (17 lines) ----------
#The inputs to this node will be stored as a list in the IN variables.
instNS = 	IN[0]	# Namespace to be used for each wall (ex http://someArchitect/projA/spaces/)
levelNS = 	IN[1]	# Namespace to be used for each storey (ex http://someArchitect/projA/levels/)
elements = 	IN[2]	# List of walls
levels = 	IN[3]	# List of storeys

# PREFIXES
str = "@prefix bot: <https://w3id.org/bot#> .\n"
str+= "@prefix wallinst: <%s> .\n" % instNS
str+= "@prefix lev: <%s> .\n\n" % levelNS

# INSTANCES
for i, level in enumerate(levels):
	element = elements[i]
	str+= 'lev:%s bot:hasElement wallinst:%s .\n' % (level.UniqueId, element.UniqueId)

OUT = str
# ----------------------------------------

watch_2 = Watch(assign_property)

# group: Write to server
code_block_2 = CodeBlock { "localhost:3030/TCI-CaseStudy-Revit/data"; }
post_to_fuseki = Python(IN[0]=code_block_2, IN[1]=watch_2)
# ---------- post_to_fuseki.python (31 lines) ----------
import sys
sys.path.append('C:\Program Files (x86)\IronPython 2.7\Lib')
import httplib, urllib

# The inputs to this node will be stored as a list in the IN variables.
url = IN[0]
triples = IN[1]

first_slash = url.find('/')
host = url[:first_slash]
route = url[first_slash:]

conn = httplib.HTTPConnection(host)

# Define headers
headers = {"Content-type": "text/turtle", "Accept": "text/plain"}

# Send request
conn.request('POST', route, triples, headers)

# Get response
response = conn.getresponse()

# Read response
data = response.read()

# Close db connection
conn.close()

# Assign your output to the OUT variable.
OUT = data
# ----------------------------------------
watch_3 = Watch(post_to_fuseki)

# group: Write to file
file_path = Filename(".\TCI_CS_storey-has-inst_fuseki-data.ttl")
writeText = FileSystem.WriteText(filePath=file_path, text=watch_2)
