# Dynamo graph TCI_CS_wall-orientation_fuseki-data.dyn (Dynamo 2.0.2.6826)

instance_namespace = CodeBlock { "http://test/walls/"; }
property_namespace = CodeBlock { "https://w3id.org/props#"; }
datatype_namespace = CodeBlock { ["xsd", "http://www.w3.org/2001/XMLSchema#"]; }
wall_types = WallTypes(index=85)
all_elements_of_family_type = Custom[All Elements of Family Type+](familyType=wall_types)  # Unlike the built-in node, this node retrieves all placed instances of a given loadable *or* system family type
wall_types_2 = WallTypes(index=86)
all_elements_of_family_type_2 = Custom[All Elements of Family Type+](familyType=wall_types_2)
wall_types_3 = WallTypes(index=88)
all_elements_of_family_type_3 = Custom[All Elements of Family Type+](familyType=wall_types_3)

# group: Get Wall Orientation
join = List.Join(list0=all_elements_of_family_type, list1=all_elements_of_family_type_2, list2=all_elements_of_family_type_3)
orientation = Custom[Wall.Orientation](wall=join)  # Gets the orientation of a given wall instance (normal of the exterior face of the wall). Will *not* work for walls hosted on mass faces or in-place walls.
XZ = Plane.XZ()
normal = Plane.Normal(plane=XZ)
# note: NB! Requires the Clockwork package
angleWithVector = Vector.AngleWithVector(vector=orientation, otherVector=normal)
round = Math.Round(number=angleWithVector)

property = CodeBlock { "props:angle"; }
datatype = CodeBlock { "xsd:decimal"; }
# note: [0]Instance namespace
# [1]Property namespace
# [2]Datatype namespace
# [3]Elements
# [4]Property Type1
# [5]Datatype1
# [6]Property1
assign_property = Python(IN[0]=instance_namespace, IN[1]=property_namespace, IN[2]=datatype_namespace, IN[3]=join, IN[4]=property, IN[5]=datatype, IN[6]=round)
# ---------- assign_property.python (24 lines) ----------
#The inputs to this node will be stored as a list in the IN variables.
instNS = 	IN[0]
propNS = 	IN[1]
dtPFX = 	IN[2][0]
dtNS = 		IN[2][1]
elements = 	IN[3]
prop1 = 	IN[4]
dt1 = 		IN[5]
property1 = IN[6]


# PREFIXES
str = "@prefix wallinst: <%s> .\n" % instNS
str+= "@prefix rdf: <http://www.w3.org/1999/02/22-rdf-syntax-ns#> .\n"
str+= "@prefix props: <%s> .\n" % propNS
str+= "@prefix %s: <%s> .\n\n" % (dtPFX, dtNS)


# INSTANCES
for i, e in enumerate(elements):
	str+= 'wallinst:%s %s "%s"^^%s .\n' % (e.UniqueId, prop1, property1[i], dt1)


OUT = str
# ----------------------------------------
watch = Watch(assign_property)

# group: Write to server
code_block = CodeBlock { "localhost:3030/TCI-CaseStudy-Revit/data"; }
post_to_fuseki = Python(IN[0]=code_block, IN[1]=watch)
# ---------- post_to_fuseki.python (31 lines) ----------
import sys
sys.path.append('C:\Program Files (x86)\IronPython 2.7\Lib')
import httplib, urllib

# The inputs to this node will be stored as a list in the IN variables.
url = IN[0]
triples = IN[1]

first_slash = url.find('/')
host = url[:first_slash]
route = url[first_slash:]

conn = httplib.HTTPConnection(host)

# Define headers
headers = {"Content-type": "text/turtle", "Accept": "text/plain"}

# Send request
conn.request('POST', route, triples, headers)

# Get response
response = conn.getresponse()

# Read response
data = response.read()

# Close db connection
conn.close()

# Assign your output to the OUT variable.
OUT = data
# ----------------------------------------
watch_2 = Watch(post_to_fuseki)

# group: Write to file
file_path = Filename(".\TCI_CS_wall-orientation_fuseki-data.ttl")
writeText = FileSystem.WriteText(filePath=file_path, text=watch)
