# Dynamo graph TCI_CS_wall-wall-adjacency.dyn (Dynamo 2.0.2.6826)

categories = Categories(index=604)
levels = Levels(index=6)
wall_types = WallTypes(index=85)
all_elements_of_family_type = Custom[All Elements of Family Type+](familyType=wall_types)  # Unlike the built-in node, this node retrieves all placed instances of a given loadable *or* system family type
wall_types_2 = WallTypes(index=86)
all_elements_of_family_type_2 = Custom[All Elements of Family Type+](familyType=wall_types_2)
wall_types_3 = WallTypes(index=88)
all_elements_of_family_type_3 = Custom[All Elements of Family Type+](familyType=wall_types_3)

# group: Get relationship Level N-1 Koblingszone
byCategoryAndLevel = archilab.Revit.Selection.Select.ByCategoryAndLevel(category=categories, level=levels)
join = List.Join(list0=all_elements_of_family_type, list1=all_elements_of_family_type_2, list2=all_elements_of_family_type_3)
setIntersection = List.SetIntersection(list1=byCategoryAndLevel, list2=join)
code_block = CodeBlock { 0.1; }
getSurroundingElements = Custom[Tool.GetSurroundingElements](Element=setIntersection, ElementCheck=setIntersection, Tolerance=code_block)  # Get Surrounding Elements by Categories, group them as List. Tolerance distance available.

# group: Generate triples
code_block_2 = CodeBlock { "http://test/walls/"; }
# note: [0] Instance namespace
# [1] Relationships
python_script = Python(IN[0]=code_block_2, IN[1]=getSurroundingElements)
# ---------- python_script.python (20 lines) ----------
instNS =		IN[0]	# Namespace to be used for space (ex http://someArchitect/projA/spaces/)
adjacencies = 	IN[1]	# List of adjacencies

# PREFIXES
str = "@prefix wallinst: <%s> .\n" % instNS
str+= "@prefix bot: <https://w3id.org/bot#> .\n\n"

for adjWalls in adjacencies:
	guidA = adjWalls[0].UniqueId
	
	adjSet = set()
	for wall in adjWalls:
		if wall != adjWalls[0] and wall not in adjSet:
			guidB = wall.UniqueId
			
			str+= 'wallinst:%s bot:adjacentElement wallinst:%s .\n' % (guidA, guidB)
			adjSet.add(wall)

#Assign your output to the OUT variable.
OUT = str
# ----------------------------------------

watch = Watch(python_script)

# group: Write to file Level N-1 Koblingszone
file_path = Filename(".\TCI_CS_wall-wall-adjacency_LevN1K.ttl")
writeText = FileSystem.WriteText(filePath=file_path, text=watch)

# group: Write to server Level N-1 Koblingszone
code_block_3 = CodeBlock { "localhost:3030/TCI-CaseStudy-Revit/data"; }
python_script_2 = Python(IN[0]=code_block_3, IN[1]=watch)
# ---------- python_script_2.python (31 lines) ----------
import sys
sys.path.append('C:\Program Files (x86)\IronPython 2.7\Lib')
import httplib, urllib

# The inputs to this node will be stored as a list in the IN variables.
url = IN[0]
triples = IN[1]

first_slash = url.find('/')
host = url[:first_slash]
route = url[first_slash:]

conn = httplib.HTTPConnection(host)

# Define headers
headers = {"Content-type": "text/turtle", "Accept": "text/plain"}

# Send request
conn.request('POST', route, triples, headers)

# Get response
response = conn.getresponse()

# Read response
data = response.read()

# Close db connection
conn.close()

# Assign your output to the OUT variable.
OUT = data
# ----------------------------------------
watch_2 = Watch(python_script_2)

categories_2 = Categories(index=604)
levels_2 = Levels(index=5)
wall_types_4 = WallTypes(index=85)
all_elements_of_family_type_4 = Custom[All Elements of Family Type+](familyType=wall_types_4)
wall_types_5 = WallTypes(index=86)
all_elements_of_family_type_5 = Custom[All Elements of Family Type+](familyType=wall_types_5)
wall_types_6 = WallTypes(index=88)
all_elements_of_family_type_6 = Custom[All Elements of Family Type+](familyType=wall_types_6)

# group: Get relationship Level N-1
byCategoryAndLevel_2 = archilab.Revit.Selection.Select.ByCategoryAndLevel(category=categories_2, level=levels_2)
join_2 = List.Join(list0=all_elements_of_family_type_4, list1=all_elements_of_family_type_5, list2=all_elements_of_family_type_6)
setIntersection_2 = List.SetIntersection(list1=byCategoryAndLevel_2, list2=join_2)
code_block_4 = CodeBlock { 0.1; }
getSurroundingElements_2 = Custom[Tool.GetSurroundingElements](Element=setIntersection_2, ElementCheck=setIntersection_2, Tolerance=code_block_4)

# group: Generate triples
code_block_5 = CodeBlock { "http://test/walls/"; }
# note: [0] Instance namespace
# [1] Relationships
python_script_3 = Python(IN[0]=code_block_5, IN[1]=getSurroundingElements_2)  # same code as python_script

watch_3 = Watch(python_script_3)

# group: Write to file Level N-1
file_path_2 = Filename(".\TCI_CS_wall-wall-adjacency_LevN1.ttl")
writeText_2 = FileSystem.WriteText(filePath=file_path_2, text=watch_3)

# group: Write to server Level N-1
code_block_6 = CodeBlock { "localhost:3030/TCI-CaseStudy-Revit/data"; }
python_script_4 = Python(IN[0]=code_block_6, IN[1]=watch_3)  # same code as python_script_2
watch_4 = Watch(python_script_4)

categories_3 = Categories(index=604)
levels_3 = Levels(index=0)
wall_types_7 = WallTypes(index=85)
all_elements_of_family_type_7 = Custom[All Elements of Family Type+](familyType=wall_types_7)
wall_types_8 = WallTypes(index=86)
all_elements_of_family_type_8 = Custom[All Elements of Family Type+](familyType=wall_types_8)
wall_types_9 = WallTypes(index=88)
all_elements_of_family_type_9 = Custom[All Elements of Family Type+](familyType=wall_types_9)

# group: Get relationship Level N-1
byCategoryAndLevel_3 = archilab.Revit.Selection.Select.ByCategoryAndLevel(category=categories_3, level=levels_3)
join_3 = List.Join(list0=all_elements_of_family_type_7, list1=all_elements_of_family_type_8, list2=all_elements_of_family_type_9)
setIntersection_3 = List.SetIntersection(list1=byCategoryAndLevel_3, list2=join_3)
code_block_7 = CodeBlock { 0.1; }
getSurroundingElements_3 = Custom[Tool.GetSurroundingElements](Element=setIntersection_3, ElementCheck=setIntersection_3, Tolerance=code_block_7)

# group: Generate triples
code_block_8 = CodeBlock { "http://test/walls/"; }
# note: [0] Instance namespace
# [1] Relationships
python_script_5 = Python(IN[0]=code_block_8, IN[1]=getSurroundingElements_3)  # same code as python_script

watch_5 = Watch(python_script_5)

# group: Write to file Level N00
file_path_3 = Filename(".\TCI_CS_wall-wall-adjacency_LevN00.ttl")
writeText_3 = FileSystem.WriteText(filePath=file_path_3, text=watch_5)

# group: Write to server Level N00
code_block_9 = CodeBlock { "localhost:3030/TCI-CaseStudy-Revit/data"; }
python_script_6 = Python(IN[0]=code_block_9, IN[1]=watch_5)  # same code as python_script_2
watch_6 = Watch(python_script_6)
