# Dynamo graph TCI-Demo_storey-has-inst_fuseki-data.dyn (Dynamo 2.0.2.6826)

storey_namespace = CodeBlock { "http://test/levels/"; }

# group: Get walls
# note: NB! Depends on package Archi-lab
categories = Categories(index=604)  # graph input
all_elements_of_category = ElementsOfCategory(Category=categories)

# group: Get storey
code_block = CodeBlock { "WALL_BASE_CONSTRAINT"; }
get_built_in_parameter = Custom[Get Built In Parameter](ParameterNames=code_block, Elements=all_elements_of_category)

watch = Watch(get_built_in_parameter)

# group: Generate triples
space_namespace = CodeBlock { "http://test/walls/"; }
# note: [0] Wall namespace
# [1] Storey namespace
# [2] Walls
# [3] Storeys
assign_property = Python(IN[0]=space_namespace, IN[1]=storey_namespace, IN[2]=all_elements_of_category, IN[3]=watch)
# ---------- assign_property.python (17 lines) ----------
#The inputs to this node will be stored as a list in the IN variables.
instNS = 	IN[0]	# Namespace to be used for each wall (ex http://someArchitect/projA/spaces/)
levelNS = 	IN[1]	# Namespace to be used for each storey (ex http://someArchitect/projA/levels/)
elements = 	IN[2]	# List of walls
levels = 	IN[3]	# List of storeys

# PREFIXES
str = "@prefix bot: <https://w3id.org/bot#> .\n"
str+= "@prefix wallinst: <%s> .\n" % instNS
str+= "@prefix lev: <%s> .\n\n" % levelNS

# INSTANCES
for i, level in enumerate(levels):
	element = elements[i]
	str+= 'lev:%s bot:hasElement wallinst:%s .\n' % (level.UniqueId, element.UniqueId)

OUT = str
# ----------------------------------------

watch_2 = Watch(assign_property)

# group: Write to server
code_block_2 = CodeBlock { "localhost:3030/TCI-Demo-Revit-data/data"; }
post_to_fuseki = Python(IN[0]=code_block_2, IN[1]=watch_2)
# ---------- post_to_fuseki.python (31 lines) ----------
import sys
sys.path.append('C:\Program Files (x86)\IronPython 2.7\Lib')
import httplib, urllib

# The inputs to this node will be stored as a list in the IN variables.
url = IN[0]
triples = IN[1]

first_slash = url.find('/')
host = url[:first_slash]
route = url[first_slash:]

conn = httplib.HTTPConnection(host)

# Define headers
headers = {"Content-type": "text/turtle", "Accept": "text/plain"}

# Send request
conn.request('POST', route, triples, headers)

# Get response
response = conn.getresponse()

# Read response
data = response.read()

# Close db connection
conn.close()

# Assign your output to the OUT variable.
OUT = data
# ----------------------------------------
watch_3 = Watch(post_to_fuseki)

# group: Write to file
file_path = Filename(".\TCI-Demo_storey-has-inst_fuseki-data.ttl")
writeText = FileSystem.WriteText(filePath=file_path, text=watch_2)
