# Dynamo graph TCI_Demo_class-assign_storey_fuseki-data.dyn (Dynamo 2.0.2.6826)

# group: Class Assignment Storey
instance_namespace = CodeBlock { "http://test/levels/"; }
class_0_namespace = CodeBlock { ["owl", "http://www.w3.org/2002/07/owl#"]; }
class_0 = CodeBlock { "owl:Class"; }
class_1_namespace = CodeBlock { ["bot", "https://w3id.org/bot#"]; }
class_1 = CodeBlock { "bot:Storey"; }
property_namespace = CodeBlock { ["props", "https://w3id.org/props#"]; }

# group: Get storey types used in model
categories = Categories(index=248)  # graph input
all_elements_of_category = ElementsOfCategory(Category=categories)
elementType = Custom[Element.ElementType+](element=all_elements_of_category)  # Gets the family type of a given element (if applicable). Unlike the OOTB node, it also works for elements in linked models.
uniqueItems = List.UniqueItems(list=elementType)

# note: [0]Instance namespace
# [1]Class 0 namespace
# [2]Class 0
# [3]Class 1 namespace
# [4]Class 1
# [5]Elements
assign_class = Python(IN[0]=instance_namespace, IN[1]=class_0_namespace, IN[2]=class_0, IN[3]=class_1_namespace, IN[4]=class_1, IN[5]=all_elements_of_category)
# ---------- assign_class.python (22 lines) ----------
#The inputs to this node will be stored as a list in the IN variables.
levNS = IN[0]
cl0PFX = IN[1][0]
cl0NS = IN[1][1]
cl0 = IN[2]
cl1PFX = IN[3][0]
cl1NS = IN[3][1]
cl1 = IN[4]
elements = IN[5]

# PREFIXES
str = "@prefix lev: <%s> .\n" % levNS
str+= "@prefix %s: <%s> .\n" % (cl0PFX, cl0NS)
str+= "@prefix %s: <%s> .\n\n" % (cl1PFX, cl1NS)

str+= "%s a owl:Class .\n\n" % (cl1)

# INSTANCES
for e in elements:
	str+= "lev:%s a %s .\n" % (e.UniqueId, cl1)

OUT = str
# ----------------------------------------
watch = Watch(assign_class)

# group: Write to server
code_block = CodeBlock { "localhost:3030/TCI-Demo-Revit-data/data"; }
post_to_fuseki = Python(IN[0]=code_block, IN[1]=watch)
# ---------- post_to_fuseki.python (31 lines) ----------
import sys
sys.path.append('C:\Program Files (x86)\IronPython 2.7\Lib')
import httplib, urllib

# The inputs to this node will be stored as a list in the IN variables.
url = IN[0]
triples = IN[1]

first_slash = url.find('/')
host = url[:first_slash]
route = url[first_slash:]

conn = httplib.HTTPConnection(host)

# Define headers
headers = {"Content-type": "text/turtle", "Accept": "text/plain"}

# Send request
conn.request('POST', route, triples, headers)

# Get response
response = conn.getresponse()

# Read response
data = response.read()

# Close db connection
conn.close()

# Assign your output to the OUT variable.
OUT = data
# ----------------------------------------
watch_2 = Watch(post_to_fuseki)

# group: Write to file
file_path = Filename(".\TCI_Demo_class-assign_storey_fuseki-data1.ttl")
writeText = FileSystem.WriteText(filePath=file_path, text=watch)

datatype_namespace = CodeBlock { ["xsd","http://www.w3.org/2001/XMLSchema#"]; }
datatype = CodeBlock { "xsd:string"; }
# note: [0]Instance namespace
# [1]Level type
# [2]Property Namespace
# [3]Elements
# [4]Datatype namespace
# [5]Datatype
python_script = Python(IN[0]=instance_namespace, IN[1]=elementType, IN[2]=property_namespace, IN[3]=all_elements_of_category, IN[4]=datatype_namespace, IN[5]=datatype)
# ---------- python_script.python (39 lines) ----------
import sys
sys.path.append(r'C:\Program Files (x86)\IronPython 2.7\Lib')
import urllib

#The inputs to this node will be stored as a list in the IN variables.

elementNS = IN[0]
elements = 	IN[1]
propPFX = 	IN[2][0]
propNS = 	IN[2][1]
labels =	IN[3]
dtPFX = 	IN[4][0]
dtNS = 		IN[4][1]
dt = 		IN[5]

def _get_id_name(e):
	# Make lowercase and replace æ, ø, å
	n = e.Name.lower()
	n = n.replace('æ', 'ae').replace('ø', 'oe').replace('å', 'aa')
	# Make PascalCaseName
	n = ''.join(x for x in n.title() if x.isalnum())
	# URL encode
	n = urllib.quote(n)
	return n

# PREFIXES
str= "@prefix lev: <%s> .\n" % elementNS
str+= "@prefix rdf: <http://www.w3.org/1999/02/22-rdf-syntax-ns#> .\n"
str+= "@prefix %s: <%s> .\n" % (propPFX, propNS)
str+= "@prefix %s: <%s> .\n\n" % (dtPFX, dtNS)

# INSTANCES
for i, e in enumerate(labels):
	cl = labels[i]
	classId = _get_id_name(cl)
	str+= 'lev:%s props:Revit_GUID  "%s" ;\n' % (e.UniqueId, e.UniqueId)
	str+= '\trdf:label "%s"^^%s .\n' % (classId, dt)

OUT = str
# ----------------------------------------
watch_3 = Watch(python_script)

# group: Write to server
code_block_2 = CodeBlock { "localhost:3030/TCI-Demo-Revit-data/data"; }
post_to_fuseki_2 = Python(IN[0]=code_block_2, IN[1]=watch_3)  # same code as post_to_fuseki
watch_4 = Watch(post_to_fuseki_2)

# group: Write to file
file_path_2 = Filename(".\TCI_Demo_class-assign_storey_fuseki-data2.ttl")
writeText_2 = FileSystem.WriteText(filePath=file_path_2, text=watch_3)
