# Dynamo graph TCI_Demo_class-assign_wall-el_fuseki-data.dyn (Dynamo 2.0.2.6826)

instance_namespace = CodeBlock { "http://test/walls/"; }
class_namespace = CodeBlock { ["owl", "http://www.w3.org/2002/07/owl#"]; }
class_ = CodeBlock { "owl:Class"; }
class_1_namespace = CodeBlock { ["bot", "https://w3id.org/bot#"]; }
class_1 = CodeBlock { "bot:Element"; }
class_2_namespace = CodeBlock { ["product", "https://w3id.org/product#"]; }
class_2 = CodeBlock { "product:Wall"; }

# group: Get elements
categories = Categories(index=604)  # graph input
all_elements_of_category = ElementsOfCategory(Category=categories)

# note: [0]Instance namespace
# [1]Class namespace
# [2]Class
# [3]Class 1 namespace
# [4]Class 1
# [5]Class 2 namespace
# [6]Class 2
# [7]Elements
assign_class = Python(IN[0]=instance_namespace, IN[1]=class_namespace, IN[2]=class_, IN[3]=class_1_namespace, IN[4]=class_1, IN[5]=class_2_namespace, IN[6]=class_2, IN[7]=all_elements_of_category)
# ---------- assign_class.python (29 lines) ----------
#The inputs to this node will be stored as a list in the IN variables.
instNS = IN[0]
cl0PFX = IN[1][0]
cl0NS = IN[1][1]
cl0 = IN[2]
cl1PFX = IN[3][0]
cl1NS = IN[3][1]
cl1 = IN[4]
cl2PFX = IN[5][0]
cl2NS = IN[5][1]
cl2 = IN[6]
elements = IN[7]

# PREFIXES
str = "@prefix wallinst: <%s> .\n" % instNS
str+= "@prefix rdfs: <http://www.w3.org/2000/01/rdf-schema#> .\n"
str+= "@prefix %s: <%s> .\n" % (cl0PFX, cl0NS)
str+= "@prefix %s: <%s> .\n" % (cl1PFX, cl1NS)
str+= "@prefix %s: <%s> .\n\n" % (cl2PFX, cl2NS)

str+= "%s a owl:Class ;\n" % (cl2)
str+= "\trdfs:subClassOf %s .\n\n" % (cl1)
	
# INSTANCES
for e in elements:
	str+= "wallinst:%s a %s .\n" % (e.UniqueId, cl2)
	

OUT = str
# ----------------------------------------
watch = Watch(assign_class)

# group: Write to server
code_block = CodeBlock { "localhost:3030/TCI-Demo-Revit-data/data"; }
post_to_fuseki = Python(IN[0]=code_block, IN[1]=watch)
# ---------- post_to_fuseki.python (31 lines) ----------
import sys
sys.path.append('C:\Program Files (x86)\IronPython 2.7\Lib')
import httplib, urllib

# The inputs to this node will be stored as a list in the IN variables.
url = IN[0]
triples = IN[1]

first_slash = url.find('/')
host = url[:first_slash]
route = url[first_slash:]

conn = httplib.HTTPConnection(host)

# Define headers
headers = {"Content-type": "text/turtle", "Accept": "text/plain"}

# Send request
conn.request('POST', route, triples, headers)

# Get response
response = conn.getresponse()

# Read response
data = response.read()

# Close db connection
conn.close()

# Assign your output to the OUT variable.
OUT = data
# ----------------------------------------
watch_2 = Watch(post_to_fuseki)

# group: Write to file
file_path = Filename(".\TCI_Demo_class-assign_wall-el_fuseki-data.ttl")
writeText = FileSystem.WriteText(filePath=file_path, text=watch)
