# Dynamo graph TCI_Demo_class-prop-wm_fuseki-data.dyn (Dynamo 2.0.2.6826)

# group: Get element types used in model
categories = Categories(index=604)  # graph input
all_elements_of_category = ElementsOfCategory(Category=categories)
# note: NB! Requires the Clockwork package
elementType = Custom[Element.ElementType+](element=all_elements_of_category)  # Gets the family type of a given element (if applicable). Unlike the OOTB node, it also works for elements in linked models.
uniqueItems = List.UniqueItems(list=elementType)

watch = Watch(uniqueItems)

# group: Get property Width
code_block = CodeBlock { "Width"; }
getParameterValueByName = Element.GetParameterValueByName(element=uniqueItems, parameterName=code_block)

watch_2 = Watch(getParameterValueByName)
property = CodeBlock { "props:material"; }
datatype_namespace = CodeBlock { ["xsd","http://www.w3.org/2001/XMLSchema#"]; }
datatype = CodeBlock { "xsd:string"; }

# group: Get Property Material
code_block_2 = CodeBlock { "Structural Material"; }
getParameterValueByName_2 = Element.GetParameterValueByName(element=uniqueItems, parameterName=code_block_2)
name = Custom[Element.Name+](element=getParameterValueByName_2)  # Gets an element's name. Unlike the OOTB node, this node should work for all Revit elements that have names and will also return the localized names of system parameters, parameter groups, display unit types, parameter types, unit symbol types and unit types.

watch_3 = Watch(name)

# group: Generate triples
class_namespace = CodeBlock { "http://test/ontology/"; }
property_namespace = CodeBlock { ["props", "https://w3id.org/props#"]; }
property_2 = CodeBlock { "props:width"; }
datatype_namespace_2 = CodeBlock { ["xsd","http://www.w3.org/2001/XMLSchema#"]; }
datatype_2 = CodeBlock { "xsd:decimal"; }
# note: [0]Instance namespace
# [1]Property namespace
# [2]Property
# [3]Datatype namespace
# [4]Datatype
# [5]Elements
# [6]Properties
assign_property = Python(IN[0]=class_namespace, IN[1]=property_namespace, IN[2]=property_2, IN[3]=datatype_namespace_2, IN[4]=datatype_2, IN[5]=watch, IN[6]=watch_2, IN[7]=property, IN[8]=datatype_namespace, IN[9]=datatype, IN[10]=watch_3)
# ---------- assign_property.python (43 lines) ----------
import sys
sys.path.append(r'C:\Program Files (x86)\IronPython 2.7\Lib')
import urllib

#The inputs to this node will be stored as a list in the IN variables.
classNS = IN[0]
propPFX = IN[1][0]
propNS = IN[1][1]
prop = IN[2]
dtPFX = IN[3][0]
dtNS = IN[3][1]
dt = IN[4]
elements = IN[5]
properties = IN[6]
prop2 = IN[7]
dt2PFX = IN[8][0]
dt2NS = IN[8][1]
dt2 = IN[9]
properties2 = IN[10]

def _get_id_name(e):
	# Make lowercase and replace æ, ø, å
	n = e.Name.lower()
	n = n.replace('æ', 'ae').replace('ø', 'oe').replace('å', 'aa')
	# Make PascalCaseName
	n = ''.join(x for x in n.title() if x.isalnum())
	# URL encode
	n = urllib.quote(n)
	return n

# PREFIXES
str = "@prefix ont: <%s> .\n" % classNS
str+= "@prefix %s: <%s> .\n" % (propPFX, propNS)
str+= "@prefix %s: <%s> .\n" % (dtPFX, dtNS)
str+= "@prefix %s: <%s> .\n\n" % (dt2PFX, dt2NS)

# INSTANCES
for i, e in enumerate(elements):
	classId = _get_id_name(e)
	str+= 'ont:%s %s "%s"^^%s ;\n' % (classId, prop, properties[i], dt)
	str+= '\t%s "%s"^^%s .\n' % (prop2, properties2[i], dt2)

OUT = str
# ----------------------------------------

watch_4 = Watch(assign_property)

# group: Write to server
code_block_3 = CodeBlock { "localhost:3030/TCI-Demo-Revit-data/data"; }
post_to_opm_rest = Python(IN[0]=code_block_3, IN[1]=watch_4)
# ---------- post_to_opm_rest.python (31 lines) ----------
import sys
sys.path.append('C:\Program Files (x86)\IronPython 2.7\Lib')
import httplib, urllib

# The inputs to this node will be stored as a list in the IN variables.
url = IN[0]
triples = IN[1]

first_slash = url.find('/')
host = url[:first_slash]
route = url[first_slash:]

conn = httplib.HTTPConnection(host)

# Define headers
headers = {"Content-type": "text/turtle", "Accept": "text/plain"}

# Send request
conn.request('POST', route, triples, headers)

# Get response
response = conn.getresponse()

# Read response
data = response.read()

# Close db connection
conn.close()

# Assign your output to the OUT variable.
OUT = data
# ----------------------------------------
watch_5 = Watch(post_to_opm_rest)

# group: Write to file
file_path = Filename(".\TCI_Demo_class-prop-wm_fuseki-data.ttl")
writeText = FileSystem.WriteText(filePath=file_path, text=watch_4)

parameters = Element.Parameters(element=uniqueItems)
