# Dynamo graph TCI_Demo_inst-prop-alh_fuseki-data.dyn (Dynamo 2.0.2.6826)

instance_namespace = CodeBlock { "http://test/walls/"; }
property_namespace = CodeBlock { "https://w3id.org/props#"; }
datatype_namespace = CodeBlock { ["xsd","http://www.w3.org/2001/XMLSchema#"]; }

# group: Get element types used in model
categories = Categories(index=604)  # graph input
all_elements_of_category = ElementsOfCategory(Category=categories)

property = CodeBlock { "props:area"; }
datatype = CodeBlock { "xsd:decimal"; }

# group: Get property (Area)
code_block = CodeBlock { "Area"; }
# note: NB! Requires the Clockwork package
getParameterValueByName = Element.GetParameterValueByName(element=all_elements_of_category, parameterName=code_block)

property_2 = CodeBlock { "props:length"; }
datatype_2 = CodeBlock { "xsd:decimal"; }

# group: Get property (Length)
code_block_2 = CodeBlock { "Length"; }
getParameterValueByName_2 = Element.GetParameterValueByName(element=all_elements_of_category, parameterName=code_block_2)

property_3 = CodeBlock { "props:height"; }
datatype_3 = CodeBlock { "xsd:decimal"; }

# group: Get property (Height)
code_block_3 = CodeBlock { "Unconnected Height"; }
getParameterValueByName_3 = Element.GetParameterValueByName(element=all_elements_of_category, parameterName=code_block_3)

datatype_namespace_2 = CodeBlock { ["xsd","http://www.w3.org/2001/XMLSchema#"]; }
datatype_4 = CodeBlock { "xsd:string"; }

# group: Get property (instance code)
code_block_4 = CodeBlock { "Sigma Instance Code"; }
getParameterValueByName_4 = Element.GetParameterValueByName(element=all_elements_of_category, parameterName=code_block_4)

watch = Watch(getParameterValueByName_4)

# group: ElementID
id = Element.Id(element=all_elements_of_category)

watch_2 = Watch(id)
# note: [0]Instance namespace
# [1]Property namespace
# [2]Datatype namespace
# [3]Elements
# [4]Property Type1
# [5]Datatype1
# [6]Property1
# [7]Property Type2
# [8]Datatype2
# [9]Property2
# [10]Property Type3
# [11]Datatype3
# [12]Property3
assign_property = Python(IN[0]=instance_namespace, IN[1]=property_namespace, IN[2]=datatype_namespace, IN[3]=all_elements_of_category, IN[4]=property, IN[5]=datatype, IN[6]=getParameterValueByName, IN[7]=property_2, IN[8]=datatype_2, IN[9]=getParameterValueByName_2, IN[10]=property_3, IN[11]=datatype_3, IN[12]=getParameterValueByName_3, IN[13]=datatype_namespace_2, IN[14]=datatype_4, IN[15]=watch, IN[16]=watch_2)
# ---------- assign_property.python (40 lines) ----------
#The inputs to this node will be stored as a list in the IN variables.
instNS = 	IN[0]
propNS = 	IN[1]
dtPFX = 	IN[2][0]
dtNS = 		IN[2][1]
elements = 	IN[3]
prop1 = 	IN[4]
dt1 = 		IN[5]
property1 = IN[6]
prop2 = 	IN[7]
dt2 = 		IN[8]
property2 = IN[9]
prop3 = 	IN[10]
dt3 = 		IN[11]
property3 = IN[12]
dt4PFX =	IN[13][0]
dt4NS =		IN[13][1]
dt4 =		IN[14]
instcode =	IN[15]
elementID = IN[16]


# PREFIXES
str = "@prefix wallinst: <%s> .\n" % instNS
str+= "@prefix rdf: <http://www.w3.org/1999/02/22-rdf-syntax-ns#> .\n"
str+= "@prefix props: <%s> .\n" % propNS
str+= "@prefix %s: <%s> .\n" % (dt4PFX, dt4NS)
str+= "@prefix %s: <%s> .\n\n" % (dtPFX, dtNS)


# INSTANCES
for i, e in enumerate(elements):
	str+= 'wallinst:%s props:Revit_GUID  "%s" ;\n' % (e.UniqueId, e.UniqueId)
	str+= '\trdf:label "%s"^^%s ;\n' % (instcode[i], dt4)
	str+= '\tprops:Element_ID "%s"^^%s ;\n' % (elementID[i], dt4)	
	str+= '\t%s "%s"^^%s ;\n' % (prop1, property1[i], dt1)
	str+= '\t%s "%s"^^%s ;\n' % (prop2, property2[i], dt2)
	str+= '\t%s "%s"^^%s .\n' % (prop3, property3[i], dt3)

OUT = str
# ----------------------------------------
watch_3 = Watch(assign_property)

# group: Write to server
code_block_5 = CodeBlock { "localhost:3030/TCI-Demo-Revit-data/data"; }
post_to_fuseki = Python(IN[0]=code_block_5, IN[1]=watch_3)
# ---------- post_to_fuseki.python (31 lines) ----------
import sys
sys.path.append('C:\Program Files (x86)\IronPython 2.7\Lib')
import httplib, urllib

# The inputs to this node will be stored as a list in the IN variables.
url = IN[0]
triples = IN[1]

first_slash = url.find('/')
host = url[:first_slash]
route = url[first_slash:]

conn = httplib.HTTPConnection(host)

# Define headers
headers = {"Content-type": "text/turtle", "Accept": "text/plain"}

# Send request
conn.request('POST', route, triples, headers)

# Get response
response = conn.getresponse()

# Read response
data = response.read()

# Close db connection
conn.close()

# Assign your output to the OUT variable.
OUT = data
# ----------------------------------------
watch_4 = Watch(post_to_fuseki)

# group: Write to file
file_path = Filename(".\TCI_Demo_inst-prop-alh_fuseki-data2.ttl")
writeText = FileSystem.WriteText(filePath=file_path, text=watch_3)

datatype_namespace_3 = CodeBlock { ["xsd","http://www.w3.org/2001/XMLSchema#"]; }
datatype_5 = CodeBlock { "xsd:string"; }

# group: Get storeys per element in model
code_block_6 = CodeBlock { "WALL_BASE_CONSTRAINT"; }
get_built_in_parameter = Custom[Get Built In Parameter](ParameterNames=code_block_6, Elements=all_elements_of_category)

watch_5 = Watch(get_built_in_parameter)
python_script = Python(IN[0]=instance_namespace, IN[1]=datatype_namespace_3, IN[2]=datatype_5, IN[3]=property_namespace, IN[4]=all_elements_of_category, IN[5]=watch_5)
# ---------- python_script.python (36 lines) ----------
import sys
sys.path.append(r'C:\Program Files (x86)\IronPython 2.7\Lib')
import urllib

#The inputs to this node will be stored as a list in the IN variables.
instNS = 	IN[0]	# Namespace to be used for each wall (ex http://someArchitect/projA/spaces/)
dtPFX = 	IN[1][0]
dtNS =		IN[1][1]
dt =		IN[2]
propsNS =	IN[3]
elements = 	IN[4]	# List of walls
levels = 	IN[5]	# List of storeys


def _get_id_name(e):
	# Make lowercase and replace æ, ø, å
	n = e.Name.lower()
	n = n.replace('æ', 'ae').replace('ø', 'oe').replace('å', 'aa')
	# Make PascalCaseName
	n = ''.join(x for x in n.title() if x.isalnum())
	# URL encode
	n = urllib.quote(n)
	return n

# PREFIXES
str = "@prefix wallinst: <%s> .\n" % instNS
str+= "@prefix %s: <%s> .\n" % (dtPFX, dtNS)
str+= "@prefix props: <%s> .\n\n" % propsNS

# INSTANCES
for i, element in enumerate(elements):
	level = levels[i]
	classId = _get_id_name(level)
	str+= 'wallinst:%s props:level_simple "%s"^^%s .\n' % (element.UniqueId, classId, dt)

OUT = str
# ----------------------------------------
watch_6 = Watch(python_script)

# group: Write to server
code_block_7 = CodeBlock { "localhost:3030/TCI-Demo-Revit-data/data"; }
post_to_fuseki_2 = Python(IN[0]=code_block_7, IN[1]=watch_6)  # same code as post_to_fuseki
watch_7 = Watch(post_to_fuseki_2)

# group: Write to file
file_path_2 = Filename(".\TCI_Demo_inst-prop-alh_fuseki-data1.ttl")
writeText_2 = FileSystem.WriteText(filePath=file_path_2, text=watch_6)

parameters = Element.Parameters(element=all_elements_of_category)
