# Dynamo graph TCI_Demo_wall-wall-adjacency.dyn (Dynamo 2.0.2.6826)

categories = Categories(index=604)  # graph input
levels = Levels(index=2)
byCategoryAndLevel = archilab.Revit.Selection.Select.ByCategoryAndLevel(category=categories, level=levels)

# group: Get relationship Level 2
code_block = CodeBlock { 0.1; }
getSurroundingElements = Custom[Tool.GetSurroundingElements](Element=byCategoryAndLevel, ElementCheck=byCategoryAndLevel, Tolerance=code_block)
watch = Watch(byCategoryAndLevel)

# group: Generate triples
code_block_2 = CodeBlock { "http://test/walls/"; }
# note: [0] Instance namespace
# [1] Relationships
python_script = Python(IN[0]=code_block_2, IN[1]=getSurroundingElements)
# ---------- python_script.python (20 lines) ----------
instNS =		IN[0]	# Namespace to be used for space (ex http://someArchitect/projA/spaces/)
adjacencies = 	IN[1]	# List of adjacencies

# PREFIXES
str = "@prefix wallinst: <%s> .\n" % instNS
str+= "@prefix bot: <https://w3id.org/bot#> .\n\n"

for adjWalls in adjacencies:
	guidA = adjWalls[0].UniqueId
	
	adjSet = set()
	for wall in adjWalls:
		if wall != adjWalls[0] and wall not in adjSet:
			guidB = wall.UniqueId
			
			str+= 'wallinst:%s bot:adjacentElement wallinst:%s .\n' % (guidA, guidB)
			adjSet.add(wall)

#Assign your output to the OUT variable.
OUT = str
# ----------------------------------------

watch_2 = Watch(python_script)

# group: Write to file Level 2
file_path = Filename(".\TCI_Demo_wall-wall-adjacency_Lev2.ttl")
writeText = FileSystem.WriteText(filePath=file_path, text=watch_2)

# group: Get relationship Level 1
categories_2 = Categories(index=604)  # graph input
levels_2 = Levels(index=1)
byCategoryAndLevel_2 = archilab.Revit.Selection.Select.ByCategoryAndLevel(category=categories_2, level=levels_2)
watch_3 = Watch(byCategoryAndLevel_2)
code_block_3 = CodeBlock { 0.1; }
getSurroundingElements_2 = Custom[Tool.GetSurroundingElements](Element=byCategoryAndLevel_2, ElementCheck=byCategoryAndLevel_2, Tolerance=code_block_3)

# group: Write to server Level 2
code_block_4 = CodeBlock { "localhost:3030/TCI-Demo-Revit-data/data"; }
python_script_2 = Python(IN[0]=code_block_4, IN[1]=watch_2)
# ---------- python_script_2.python (31 lines) ----------
import sys
sys.path.append('C:\Program Files (x86)\IronPython 2.7\Lib')
import httplib, urllib

# The inputs to this node will be stored as a list in the IN variables.
url = IN[0]
triples = IN[1]

first_slash = url.find('/')
host = url[:first_slash]
route = url[first_slash:]

conn = httplib.HTTPConnection(host)

# Define headers
headers = {"Content-type": "text/turtle", "Accept": "text/plain"}

# Send request
conn.request('POST', route, triples, headers)

# Get response
response = conn.getresponse()

# Read response
data = response.read()

# Close db connection
conn.close()

# Assign your output to the OUT variable.
OUT = data
# ----------------------------------------
watch_4 = Watch(python_script_2)

# group: Generate triples
code_block_5 = CodeBlock { "http://test/walls/"; }
# note: [0] Instance namespace
# [1] Relationships
python_script_3 = Python(IN[0]=code_block_5, IN[1]=getSurroundingElements_2)  # same code as python_script

watch_5 = Watch(python_script_3)

# group: Write to file Level 1
file_path_2 = Filename(".\TCI_Demo_wall-wall-adjacency_Lev1.ttl")
writeText_2 = FileSystem.WriteText(filePath=file_path_2, text=watch_5)

# group: Write to server Level 1
code_block_6 = CodeBlock { "localhost:3030/TCI-Demo-Revit-data/data"; }
python_script_4 = Python(IN[0]=code_block_6, IN[1]=watch_5)  # same code as python_script_2
watch_6 = Watch(python_script_4)
